vi "Close.gvi"   [LabVIEW NXG 3.0.0]
# Use this VI to close references needed by the dam.
# This VI executes regardless of any incoming error.
inputs:
  "Dam in": "Dam.gtype", required
  "Error in": error
outputs:
  "Error out": error
uses:
  Turbine.gtype::Close.gvi
  Floodgate.gtype::Close.gvi
  Lake.gtype::Close.gvi
  NI::G Core::Error::Multiplex Errors.gvi
diagram:
  Property Node(instance in=$"Dam in") -> ("Lake"=w1, "Large floodgates"=w2, "Small floodgates"=w3, "Turbines"=w4, error out=w5)
  for {
    w6 = each element of w4
    call "Close.gvi"(Turbine in=w6, Error in=w5) -> (Error out=w8)
    append w8 to w7
  }
  for {
    w9 = each element of w3
    call "Close.gvi"(Floodgate in=w9, Error in=w5) -> (Error out=w11)
    append w11 to w10
  }
  call "Close.gvi"(Lake in=w1, Error in=w5) -> (Error out=w12)
  for {
    w13 = each element of w2
    call "Close.gvi"(Floodgate in=w13, Error in=w5) -> (Error out=w15)
    append w15 to w14
  }
  call "Multiplex Errors.gvi"(error in 1=$"Error in", error in 2=w12, error array in=w14) -> (error out=w16)
  call "Multiplex Errors.gvi"(error in 1=w16, error array in=w10) -> (error out=w17)
  call "Multiplex Errors.gvi"(error in 1=w17, error array in=w7) -> (error out=w18)
  $"Error out" <- w18
