vi "Init.gvi"   [LabVIEW NXG 3.0.0]
# This VI creates a dam based on it’s last logged state in the status backup input. You can also initialize the log using the Log Path In input.
inputs:
  "Log Path In": path
  "Reset?": bool
  "Error in": error
  "Status backup": path
outputs:
  "Log Path Out": path
  "Dam out": "Dam.gtype"
  "Error out": error
  "Dam's Max Power Output (MW)": f64
  "Dam's data": "Report Data.gtype"
types:
  "Lake properties.gtype" = cluster{"Lake Fill (Acre-feet)": f64, "Lake Intake Rate (cfs)": f64, "Lake Discharge Rate (cfs)": f64}
  "Large Floodgates properties.gtype" = cluster{"# of Large Floodgates": i32, "Large Flodgates Size (cfs)": f64, "Large Floodgates Status": bool[]}
  "Small Floodgates properties.gtype" = cluster{"# of Small Floodgates": i32, "Small Floodgates Size (cfs)": f64, "Small Floodgates Status": bool[]}
  "Turbines properties.gtype" = cluster{"# of Turbines": i32, "Power at Max Flow (MW)": f64, "Turbine Gates Status": bool[], "Turbines State (%)": f64[], "Total Power Being Generated (MW)": f64, "Max Flow (cfs)": f64}
  "Report Data.gtype" = cluster{"Lake properties": "Lake properties.gtype", "Large Floodgates properties": "Large Floodgates properties.gtype", "Small Floodgates properties": "Small Floodgates properties.gtype", "Turbines properties": "Turbines properties.gtype"}
uses:
  Dam.gtype::Open Config File.gvi
  Dam.gtype::Read Config File.gvi
  Turbine.gtype::Init.gvi
  Turbine.gtype::Read Generated Power.gvi
  Floodgate.gtype::Init.gvi
  Floodgate.gtype::Get Discharge.gvi
  Lake.gtype::Init.gvi
  Lake.gtype::Add Discharge.gvi
  Report.gtype::Open or Create.gvi
  Dam.gtype::Get Dams Data.gvi
diagram:
  call "Default Settings.gvi"() -> (Output=w1)
  # Lake discharge is calculated when the application starts,
  # so we make sure we have the correct amount
  case ($"Error in") {
    frame No Error {
      call "Open Config File.gvi"(Dam in="Dam.gtype" constant, Status backup=$"Status backup", Error in=$"Error in") -> (Dam out=w7, Error out=w8)
      # w9: If there is an error in the file read or reset is TRUE: pre-load the defaults
      call "Read Config File.gvi"(Dam in=w7, Dam Data In=w1, Error in=w8) -> (Dam out=w10, Dam Data Out=w11, Error out=w9)
      Logical Or($"Reset?", w9) -> w12
      Select(s=w12, t=w1, f=w11) -> w13
      Property Node(instance in=w13) -> ("Lake properties"=w14, "Large Floodgates properties"=w15, "Small Floodgates properties"=w16, "Turbines properties"=w17)
      Property Node(instance in=w17) -> ("# of Turbines"=w18, "Power at Max Flow (MW)"=w19, "Turbine Gates Status"=w20, "Turbines State (%)"=w21, "Max Flow (cfs)"=w22)
      s1 = w8  # shift register
      for (N = w18) (iteration -> i1) {
        Array Index(array=w20) -> (out0[i1]=w26)
        Array Index(array=w21) -> (out0[i1]=w27)
        call "Init.gvi"(Power at Max Flow (MW)=w19, Gate State (FALSE = Closed)=w26, Open Percentage (%)=w27, Error in=s1, Max Flow (cfs)=w22) -> (Turbine out=w28, Error out=w29)
        call "Read Generated Power.gvi"(Turbine in=w28, Error in=w29) -> (Power at Max Flow (MW)=w30, Turbine out=w31, Error out=w32, Flow (cfs)=w33)
        append w31 to w23
        append w33 to w24
        append w30 to w25
        next s1 = w32
      }
      Property Node(instance in=w15) -> ("# of Large Floodgates"=w34, "Large Flodgates Size (cfs)"=w35, "Large Floodgates Status"=w36)
      s2 = w8  # shift register
      for (N = w34) (iteration -> i2) {
        Array Index(array=w36) -> (out0[i2]=w39)
        call "Init.gvi"(Size (cfs)=w35, State (FALSE = Closed)=w39, Error in=s2) -> (Floodgate out=w40, Error out=w41)
        call "Get Discharge.gvi"(Floodgate in=w40, Error in=w41) -> (Floodgate out=w42, Discharge (cfs)=w43, Error out=w44)
        append w42 to w37
        append w43 to w38
        next s2 = w44
      }
      Property Node(instance in=w16) -> ("# of Small Floodgates"=w45, "Small Floodgates Size (cfs)"=w46, "Small Floodgates Status"=w47)
      s3 = w8  # shift register
      for (N = w45) (iteration -> i3) {
        Array Index(array=w47) -> (out0[i3]=w50)
        call "Init.gvi"(Size (cfs)=w46, State (FALSE = Closed)=w50, Error in=s3) -> (Floodgate out=w51, Error out=w52)
        call "Get Discharge.gvi"(Floodgate in=w51, Error in=w52) -> (Floodgate out=w53, Discharge (cfs)=w54, Error out=w55)
        append w53 to w48
        append w54 to w49
        next s3 = w55
      }
      Property Node(instance in=w14) -> ("Lake Fill (Acre-feet)"=w56, "Lake Intake Rate (cfs)"=w57)
      call "Init.gvi"(Fill (Acre-feet)=w56, Intake Rate (cfs)=w57, Discharge Rate (cfs)=0, Error in=w8) -> (Lake out=w58, Error out=w59)
      Add Array Elements(numeric array=w38) -> (sum=w60)
      Add Array Elements(numeric array=w49) -> (sum=w61)
      Add Array Elements(numeric array=w24) -> (sum=w62)
      Add(w60, w61, w62) -> w63
      call "Add Discharge.gvi"(Lake in=w58, Add Discharge Rate (cfs)=w63, Error in=w59) -> (Lake out=w64, Error out=w65)
      call "Open or Create.gvi"(Log Path In=$"Log Path In", Error in=w8) -> (Report out=w66, Log Path Out=w4, Error out=w67)
      Merge Errors(w65, s2, s3, s1, w67) -> (error out=w68)
      Property Node(instance in=w10, "Lake"=w64, "Turbines"=w23, "Large floodgates"=w37, "Small floodgates"=w48, "Report"=w66, error in=w68) -> (error out=w69, instance out=w70)
      call "Get Dams Data.gvi"(Dam in=w70, Error in=w69) -> (Dam out=w3, Dam's data=w6, Error out=w2)
      Add Array Elements(numeric array=w25) -> (sum=w5)
    }
    frame Error {
      w2 = $"Error in"
      w3 = "Dam.gtype" constant
      w4 = default
      w5 = default
      w6 = w1
    }
  }
  $"Dam out" <- w3
  $"Dam's data" <- w6
  $"Error out" <- w2
  $"Log Path Out" <- w4
  $"Dam's Max Power Output (MW)" <- w5
