vi "Open or Create.gvi"   [LabVIEW NXG 3.0.0]
# This VI takes in a report path and opens a reference to it. If it is not already created, it will create it and set the default data.
# If the report’s path it will default to <Public Documents>/Dam_Log.csv
inputs:
  "Log Path": path
  "Error in": error
outputs:
  "Report out": "Report.gtype"
  "Error out": error
uses:
  NI::G Core::File IO (General)::Get System Directory.gvi
diagram:
  case ($"Error in") {
    frame No Error {
      Is Empty String Or Path(string/path=$"Log Path") -> w3
      case (w3) {
        frame False, Default {
          w4 = $"Log Path"
        }
        frame True {
          call "Get System Directory.gvi"(type="Public Documents", create directory if not found?=FALSE) -> (system directory=w5)
          Build Path(base path=w5, name or relative path="Dam_Log.csv") -> (appended path=w4)
        }
      }
      Open Or Create Or Replace File(error in=$"Error in", file path (use dialog)=w4, operation (0:open)="open or create") -> (error out=w6, refnum out=w7)
      Get File Size(error in=w6, file=w7) -> (error out=w8, refnum out=w9, size (in bytes)=w10)
      Set File Position(error in=w8, offset (in bytes) (0)=w10, refnum=w9) -> (error out=w11, refnum out=w12)
      Property Node(instance in="Report.gtype" constant, "Log Path"=w4, "Report Refnum"=w12, error in=w11) -> (error out=w1, instance out=w2)
    }
    frame Error {
      w1 = $"Error in"
      w2 = "Report.gtype" constant
    }
  }
  $"Report out" <- w2
  $"Error out" <- w1
