vi "Write Status.gvi"   [LabVIEW NXG 3.0.0]
# Writes a new entry to the log with the current dam’s status.
inputs:
  "Report Data": "Report Data.gtype" = {"Lake properties"={"Lake Fill (Acre-feet)"=0, "Lake Intake Rate (cfs)"=0, "Lake Discharge Rate (cfs)"=0}, "Large Floodgates properties"={"# of Large Floodgates"=4, "Large Flodgates Size (cfs)"=0, "Large Floodgates Status"=[]}, "Small Floodgates properties"={"# of Small Floodgates"=5, "Small Floodgates Size (cfs)"=0, "Small Floodgates Status"=[]}, "Turbines properties"={"# of Turbines"=2, "Power at Max Flow (MW)"=0, "Turbine Gates Status"=[], "Turbines State (%)"=[], "Total Power Being Generated (MW)"=0}}, required
  "Report in": "Report.gtype", required
  "Error in": error
outputs:
  "Report out": "Report.gtype"
  "Error out": error
panel indicators:
  "Log Entry": string[]
types:
  "Lake properties.gtype" = cluster{"Lake Fill (Acre-feet)": f64, "Lake Intake Rate (cfs)": f64, "Lake Discharge Rate (cfs)": f64}
  "Large Floodgates properties.gtype" = cluster{"# of Large Floodgates": i32, "Large Flodgates Size (cfs)": f64, "Large Floodgates Status": bool[]}
  "Small Floodgates properties.gtype" = cluster{"# of Small Floodgates": i32, "Small Floodgates Size (cfs)": f64, "Small Floodgates Status": bool[]}
  "Turbines properties.gtype" = cluster{"# of Turbines": i32, "Power at Max Flow (MW)": f64, "Turbine Gates Status": bool[], "Turbines State (%)": f64[], "Total Power Being Generated (MW)": f64}
  "Report Data.gtype" = cluster{"Lake properties": "Lake properties.gtype", "Large Floodgates properties": "Large Floodgates properties.gtype", "Small Floodgates properties": "Small Floodgates properties.gtype", "Turbines properties": "Turbines properties.gtype"}
diagram:
  case ($"Error in") {
    frame No Error {
      Property Node(instance in=$"Report Data") -> ("Lake properties"=w4, "Large Floodgates properties"=w5, "Small Floodgates properties"=w6, "Turbines properties"=w7)
      Property Node(instance in=w6) -> ("Small Floodgates Status"=w8)
      Property Node(instance in=w5) -> ("Large Floodgates Status"=w9)
      Build Array(w9, w8) -> w10
      for {
        w11 = each element of w10
        Select(s=w11, t="OPEN", f="CLOSED") -> w13
        append w13 to w12
      }
      Property Node(instance in=w7) -> ("Turbine Gates Status"=w14, "Turbines State (%)"=w15, "Total Power Being Generated (MW)"=w16)
      for {
        w17 = each element of w14
        w18 = each element of w15
        Select(s=w17, t="OPEN", f="CLOSED") -> w21
        Number To Fractional String(number=w18) -> (F-format string=w22)
        append w21 to w19
        append w22 to w20
      }
      Property Node(instance in=w4) -> ("Lake Fill (Acre-feet)"=w23, "Lake Intake Rate (cfs)"=w24, "Lake Discharge Rate (cfs)"=w25)
      Number To Fractional String(number=w23) -> (F-format string=w26)
      Number To Fractional String(number=w16) -> (F-format string=w27)
      Number To Fractional String(number=w25) -> (F-format string=w28)
      Subtract(x=w24, y=w25) -> w29
      Is Equal To 0(x=w29) -> w30
      Is Greater Than 0(x=w29) -> w31
      Select(s=w31, t="Increasing Trend", f="Decreasing Trend") -> w32
      Select(s=w30, t="Flat Trend", f=w32) -> w33
      Format Date Time String(time format string (%c)="%m/%d/%Y %H:%M:%S") -> (date/time string=w34)
      Build Array(w34, w26, w12, w19, w20, w27, w28, w33) -> w3
      w1 = $"Error in"
      w2 = $"Report in"
    }
    frame Error {
      w1 = $"Error in"
      w2 = $"Report in"
      w3 = default
    }
  }
  $"Report out" <- w2
  $"Error out" <- w1
  $"Log Entry" <- w3
