vi "Main.gvi"   [LabVIEW NXG 3.0.0]
panel controls:
  "Stop": bool
  "Settings": i32
  "Inflow (cfs)": f64 = 1000
  "Large Floodgates Status": bool[] = [FALSE, FALSE, FALSE, FALSE]
  "Small Floodgates Status": bool[] = [FALSE, FALSE, FALSE, FALSE]
  "Turbines Status": bool[] = [FALSE, TRUE, FALSE, FALSE]
  "Turbines Open Gap (%)": f64[] = [41.8597271091, 60.594530904]
  "Reset": bool
  "Load Config File": path
  "Save Config File": bool
panel indicators:
  "Lake Fill (Acre-feet)": f64
  "Inflow (cfs) reading": f64
  "Total Power Generation (MW)": f64
  "Log Path": path
  "Fill (Acre-feet)": f64
types:
  T1 = cluster{"Element 1": bool[], "Element 2": bool[]}
uses:
  NI::G Core::Error::Build Error Cluster.gvi
  Dam.gtype::Close.gvi
  Dam.gtype::Update Dam.gvi
  Dam.gtype::Log Status.gvi
  NI::G Core::Error::Clear Error Cluster.gvi
  Dam.gtype::Init.gvi
  Dam.gtype::Set Lake Inflow.gvi
  Dam.gtype::Set Turbines Status.gvi
  Dam.gtype::Set Floodgates Status.gvi
  Dam.gtype::Write Config File.gvi
  NI::G Core::Error::Multiplex Errors.gvi
  NI::G Core::Error::Display Error.gvi
diagram:
  call "Open QMH.gvi"() -> (Message Queue=w1, Stop Event=w2, error out=w3)
  call "Send Message.gvi"(Queue in=w1, Command="Initialize", Data=FALSE, Input=w3) -> (Queue out=w4, Output=w5)
  Register For Events("Stop Event"=w2, error in=w5) -> (error out=w6, event registration refnum out=w7)
  while {
    event (timeout = 50) (dynamic events = w7) {
      on "Stop" Value changed {
        call "Send Message.gvi"(Queue in=w4, Command="Stop", Data=w6, Input=w6) -> (Output=w9)
        # This case sends a stop to the dam
        # It DOES NOT stop the consumer loop
        w8 = default
      }
      on "Dynamic" Stop Event {
        # This case stops the consumer loop
        # We make sure this can only happen if the producer loop stops too
        Event Data() -> ("event data"=w8)
        w9 = w6
      }
      on Timeout {
        call "Update Dam and Log.gvi"(Message Queue In=w4, Dam Update Time=1, Log Time=60, Error Input=w6) -> (Error Output=w9)
        # This case is used to keep the dam updated
        # Configure here the timing in which we refresh the dam
        # and the timing in which we log.
        w8 = default
      }
      on "Reset" Value changed {
        # This case sends a reset to the dam
        # It sets all values to the default data
        Build Cluster(TRUE, path constant) -> w10
        call "Send Message.gvi"(Queue in=w4, Command="Initialize", Data=w10, Input=w6) -> (Output=w9)
        w8 = default
      }
      on "Inflow (cfs)" Value changed {
        call "Send Message.gvi"(Queue in=w4, Command="Change Inflow", Data=$"Inflow (cfs)", Input=w6) -> (Output=w9)
        # This case sends a new inflow to the dam
        w8 = default
      }
      on "Turbines Open Gap (%)" Value changed; "Turbines Status" Value changed {
        Build Cluster($"Turbines Status", $"Turbines Open Gap (%)") -> w11
        # This case sends a new turbine settings to the dam
        call "Send Message.gvi"(Queue in=w4, Command="ChangeTurbines Status", Data=w11, Input=w6) -> (Output=w9)
        w8 = default
      }
      on "Large Floodgates Status" Value changed; "Small Floodgates Status" Value changed {
        Build Cluster($"Large Floodgates Status", $"Small Floodgates Status") -> w12
        # This case sends new floodgate settings to the dam
        call "Send Message.gvi"(Queue in=w4, Command="Change Floodgates Status", Data=w12, Input=w6) -> (Output=w9)
        w8 = default
      }
      on "Load Config File" Value changed {
        # This case sends a new config file to the dam
        # It sets all values to the default data
        Build Cluster(FALSE, $"Load Config File") -> w13
        call "Send Message.gvi"(Queue in=w4, Command="Initialize", Data=w13, Input=w6) -> (Output=w9)
        w8 = default
      }
      on "Save Config File" Value changed {
        call "Send Message.gvi"(Queue in=w4, Command="Save Config File", Input=w6) -> (Output=w9)
        w8 = default
      }
    }
    call "Error Check.gvi"(Message Queue In=w4, Error In=w9) -> (Message Queue Out=w14, Error Output=w15)
    Logical Or(w15, w8) -> w16
    stop if w16
  }
  s1 = "Dam.gtype" constant  # shift register
  while {
    call "Read Message.gvi"(Message Queue In=w4, Error in=w6) -> (Message Queue Out=w17, Command=w18, Data=w19, Error out=w20)
    case (w18) {
      frame Default {
        # This case executes when an undefined command arrives
        Format Into String(initString="Unknown command received: ", errIn=w20, w18) -> (outString=w24, errOut=w25)
        call "Build Error Cluster.gvi"(error in=w25, code=5000, description=w24) -> (error out=w21)
        w22 = default
        w23 = s1
      }
      frame "Stop" {
        Variant To Data(error in (no error)=w20, type=w20, variant=w19) -> (data=w26, error out=w27)
        Generate User Event(error in=w27, event data=TRUE, user event=w2) -> (error out=w28)
        call "Close.gvi"(Dam in=s1, Error in=w28) -> (Error out=w29)
        # This case stops the dam and sends a stop command to the producer loop
        Merge Errors(w26, w29) -> (error out=w21)
        w22 = TRUE
        w23 = "Dam.gtype" constant
      }
      frame "Update Dam" {
        call "Update Dam.gvi"(Dam in=s1, Error in=w20) -> (Dam out=w23, Fill (Acre-feet)=w30, Power Generated (MW)=w31, Error out=w21)
        $"Fill (Acre-feet)" <- w30
        $"Lake Fill (Acre-feet)" <- w30
        # This case should be run every second to make sure the dam updates its levels every second.
        $"Total Power Generation (MW)" <- w31
        w22 = default
      }
      frame "Log" {
        # This case asks the dam to log its state into its report
        call "Log Status.gvi"(Dam in=s1, Error in=w20) -> (Dam out=w23, Error out=w21)
        w22 = default
      }
      frame "Initialize" {
        Clear Data(reference in=reference to "Lake Fill (Acre-feet)") -> (error out=w32)
        call "Clear Error Cluster.gvi"(error in=w32)
        w33 = cluster{"Element 1": bool, "Element 2": path} {all zero or empty}
        Variant To Data(type=w33, variant=w19) -> (data=w34, error out=w35)
        call "Clear Error Cluster.gvi"(error in=w35)
        call "Close.gvi"(Dam in=s1, Error in=w20) -> (Error out=w36)
        call "Clear Error Cluster.gvi"(error in=w36) -> (error out=w37)
        Property Node(instance in=w34) -> ("Element 1"=w38, "Element 2"=w39)
        call "Init.gvi"(Status backup=w39, Reset?=w38, Error in=w37) -> (Dam's data=w40, Dam out=w23, Log Path Out=w41, Error out=w21)
        $"Log Path" <- w41
        Property Node(instance in=w40) -> ("Lake properties"=w42, "Large Floodgates properties"=w43, "Small Floodgates properties"=w44, "Turbines properties"=w45)
        Property Node(instance in=w42) -> ("Lake Intake Rate (cfs)"=w46)
        $"Inflow (cfs) reading" <- w46
        $"Inflow (cfs)" <- w46
        # This case initializes a new dam.
        # You can use it to reset it to its default values, too
        Property Node(instance in=w43) -> ("Large Floodgates Status"=w47)
        $"Large Floodgates Status" <- w47
        Property Node(instance in=w44) -> ("Small Floodgates Status"=w48)
        $"Small Floodgates Status" <- w48
        Property Node(instance in=w45) -> ("Turbine Gates Status"=w49, "Turbines State (%)"=w50)
        $"Turbines Status" <- w49
        $"Turbines Open Gap (%)" <- w50
        w22 = default
      }
      frame "Change Inflow" {
        Variant To Data(error in (no error)=w20, type=f64 0, variant=w19) -> (data=w51, error out=w52)
        call "Set Lake Inflow.gvi"(Dam in=s1, Intake Rate (cfs)=w51, Error in=w52) -> (Dam out=w23, Intake Rate out (cfs)=w53, Error out=w21)
        # Use this case to change the inflow rate of the dam
        $"Inflow (cfs) reading" <- w53
        w22 = default
      }
      frame "ChangeTurbines Status" {
        # Use this case to change the turbines status of the dam
        w54 = cluster{"Element 1": bool[], "Element 2": f64[]} {all zero or empty}
        Variant To Data(error in (no error)=w20, type=w54, variant=w19) -> (data=w55, error out=w56)
        Property Node(instance in=w55) -> ("Element 1"=w57, "Element 2"=w58)
        call "Set Turbines Status.gvi"(Dam in=s1, Turbines Status=w57, Turbine Gates=w58, Error in=w56) -> (Dam out=w23, Turbines Status Out=w59, Turbine Gates Out=w60, Error out=w21)
        $"Turbines Status" <- w59
        $"Turbines Open Gap (%)" <- w60
        w22 = default
      }
      frame "Change Floodgates Status" {
        # Use this case to change the turbines status of the dam
        Variant To Data(error in (no error)=w20, type=T1 {all zero or empty}, variant=w19) -> (data=w61, error out=w62)
        Property Node(instance in=w61) -> ("Element 1"=w63, "Element 2"=w64)
        call "Set Floodgates Status.gvi"(Dam in=s1, Large Floodgates Status=w63, Small Floodgates Status=w64, Error in=w62) -> (Dam out=w23, Large Floodgates Status Out=w65, Small Floodgates Status Out=w66, Error out=w21)
        $"Large Floodgates Status" <- w65
        $"Small Floodgates Status" <- w66
        w22 = default
      }
      frame "Save Config File" {
        call "Write Config File.gvi"(dam.gtype out=s1, error in=w20) -> (dam.gtype in=w23, error out=w21)
        w22 = default
      }
    }
    call "Error Check.gvi"(Message Queue In=w17, Error In=w21) -> (Error Output=w67)
    Merge Errors(w21, w67) -> (error out=w68)
    next s1 = w23
    stop if w22
  }
  call "Multiplex Errors.gvi"(error in 1=w15, error in 2=w68) -> (error out=w69)
  Unregister For Events(error in=w69, event registration refnum=w7) -> (error out=w70)
  call "Close QMH.gvi"(Message Queue=w14, Stop Event=w2, error in=w70) -> (error out=w71)
  call "Display Error.gvi"(error in=w71)
