vi "Main.gviweb"   [LabVIEW NXG 3.0.0]
# This template is for the Queued Message Handler design pattern. The Event Handling Loop generates messages based on user interface actions. The Message Handling Loop processes messages generated by the Event Handling Loop, or by other messages. The messages are string values, so new messages can be added easily to the Message Cases case structure in the Message Handling Loop. Each message cluster can also provide an optional value for Message Data,  which is a String that can be swapped to whatever type of data is required.
panel controls:
  "Exit": bool
  "Tasks": i32
  "Clear Faults": bool
  "Robot ON/OFF": bool
  "Fail Setting": T1 = "Retry"
  "Add Tasks": i32
  "Tee Holes": bool[] = [FALSE, FALSE, FALSE, FALSE, FALSE, FALSE, FALSE, FALSE, FALSE]
  "Sand Traps": bool[] = [FALSE, FALSE, FALSE]
  "Patch All Tee Holes": bool
  "Patch Selected Tee Holes": bool
  "Rake All Sand Traps": bool
  "Rake Selected Sand Traps": bool
  "Retrieve Balls": bool
panel indicators:
  "Pending Tasks": string[]
  "Completed Tasks": string[]
  "Faults and alerts": string[]
  "Sequence Progress": f64
  "Robot Status": string
types:
  T1 = enum{"Retry", "Alert", "Alert and Retry", "Ignore"}
  "Robot Status.gtype" = enum{"Off", "Idle", "Running", "Paused", "Error"}
  "Task Types.gtype" = enum{"Patch Tee Hole", "Rake Sand Trap", "Retrieve Balls from Creek"}
  "Task Status.gtype" = enum{"Waiting", "Running", "Completed", "Failed"}
  "Task Data.gtype" = cluster{"Task Type": "Task Types.gtype", "Remaining time (s)": f64, "Status": "Task Status.gtype", "Index": u32, "Start Time": timestamp, "End Time": timestamp}
  "Robot Data.gtype" = cluster{"Start Time": timestamp, "Robot Status": "Robot Status.gtype", "Completed Tasks": "Task Data.gtype"[], "Tasks in Queue": "Task Data.gtype"[], "Alerts": error[]}
uses:
  Application::support::Message Queue::Create All Message Queues.gviweb
  Application::support::Message Queue::Dequeue Message.gviweb
  NI::G Core::Error::Build Error Cluster.gvi
  Application::Task functions::Time Constants FGV.gviweb
  Application::support::Message Queue::Enqueue Message (Single).gviweb
  Application::Robot functions::Parse Faults and Alerts.gviweb
  NI::G Core::Error::Clear Error Cluster.gvi
  Application::Robot functions::Process Task.gviweb
  Application::support::Error Handler - Message Handling Loop.gviweb
  Application::support::Error Handler - Event Handling Loop.gviweb
diagram:
  w1 = bool FALSE  # Stop Event
  Create User Event[EventName="Stop Event"](user event data type=w1) -> (error out=w2, user event out=w3)
  call "Create All Message Queues.gviweb"(error in=w2) -> (message queues=w4, error out=w5)
  Property Node(instance in=w4) -> ("message queue"=w6)
  w7 = "Robot Data.gtype" {"Start Time"=1904-01-01T00:00:00Z, "Robot Status"="Idle", "Completed Tasks"=[], "Tasks in Queue"=[], "Alerts"=[]}
  s1 = w7  # shift register
  while {
    # w3: Stop Event
    # s1: Data
    call "Dequeue Message.gviweb"(message queue in=w6, error in=w5) -> (message queue out=w8, message=w9, message data=w10, error out=w11)
    case (w9) ignore case {  # Message Cases
      frame Default {
        w15 = "The invalid message string \"%s\" was received in the Message Handling Loop."
        Format Into String(formatString=w15, w9) -> w16
        call "Build Error Cluster.gvi"(code=1, description=w16) -> (error out=w12)
        w13 = s1
        w14 = default
      }
      frame "Initialize" {
        w17 = ["Patch Tee Hole", "Rake Sand Trap", "Retrieve Balls from Creek"]
        call "Time Constants FGV.gviweb"(Status=w17, Time=[5, 10, 15], Write?=TRUE)
        call "Enqueue Message (Single).gviweb"(message queue in=w8, message="Update Display", error in=w11) -> (error out=w12)
        Get Current Time() -> (current time=w18)
        Property Node(instance in=s1, "Start Time"=w18, "Robot Status"="Off", "Completed Tasks"="Task Data.gtype"[] [], "Tasks in Queue"="Task Data.gtype"[] []) -> (instance out=w13)
        $"Robot ON/OFF" <- FALSE
        w14 = default
      }
      frame "Update Display" {
        Property Node(instance in=s1) -> ("Robot Status"=w19, "Alerts"=w20, instance out=w13)
        Format Into String(errIn=w11, w19) -> (outString=w21, errOut=w12)
        $"Robot Status" <- w21
        call "Parse Faults and Alerts.gviweb"(Alerts=w20) -> (Faults and alerts=w22)
        $"Faults and alerts" <- w22
        w14 = default
      }
      frame "Error" {
        Property Node(instance in=s1) -> ("Alerts"=w23, instance out=w24)
        Build Array(w23, w11) -> w25
        Property Node(instance in=w24, "Alerts"=w25) -> (instance out=w13)
        call "Clear Error Cluster.gvi"(error in=w11) -> (error out=w12)
        w14 = default
      }
      frame "Idle/Timeout" {
        call "Process Task.gviweb"(Input info=s1, Input arguments=w10, Fail Setting=$"Fail Setting", Error In=w11) -> (Output info=w13, Error Out=w12)
        w14 = default
      }
      frame "Exit" {
        Release Queue(error in=w11, queue=w8) -> (error out=w26)
        Generate User Event(event data=TRUE, user event=w3) -> (error out=w27)
        # Stop the VI
        Merge Errors(w27, w26) -> (error out=w12)
        w13 = s1
        w14 = TRUE
      }
      frame "Turn On Robot" {
        w12 = w11
        w13 = s1
        w14 = default
      }
      frame "Turn Off Robot" {
        w12 = w11
        w13 = s1
        w14 = default
      }
      frame "Patch" {
        w12 = w11
        w13 = s1
        w14 = default
      }
      frame "Rake" {
        w12 = w11
        w13 = s1
        w14 = default
      }
      frame "Retrieve Balls" {
        w12 = w11
        w13 = s1
        w14 = default
      }
      frame "Clear Alerts" {
        call "Enqueue Message (Single).gviweb"(message queue in=w8, message="Update Display", error in=w11) -> (error out=w12)
        Property Node(instance in=s1, "Alerts"=error[] []) -> (instance out=w13)
        w14 = default
      }
    }
    call "Error Handler - Message Handling Loop.gviweb"(message queue in=w8, error in=w12) -> (dup error in=w28)
    next s1 = w13
    stop if w14
  }
  Register For Events("Stop Event"=w3) -> (event registration refnum out=w29)
  s2 = w29  # shift register
  while {
    event (timeout = 100) (dynamic events = s2) {
      on "Dynamic" Stop Event {
        w30 = TRUE
        w31 = no error
        w32 = w6
      }
      on "Exit" Value changed {
        call "Enqueue Message (Single).gviweb"(priority message=TRUE, message queue in=w6, message="Exit") -> (message queue out=w32, error out=w31)
        w30 = default
      }
      on Timeout {
        Get Current Time() -> (current time=w33)
        Time Stamp To Double Precision Float(number=w33) -> (double precision float=w34)
        Number To Fractional String(number=w34, precision (6)=20) -> (F-format string=w35)
        call "Enqueue Message (Single).gviweb"(message queue in=w6, message="Idle/Timeout", message data=w35) -> (message queue out=w32, error out=w31)
        w30 = default
      }
      on "Robot ON/OFF" Value changed {
        Select(s=$"Robot ON/OFF", t="Turn On Robot", f="Turn Off Robot") -> w36
        call "Enqueue Message (Single).gviweb"(message queue in=w6, message=w36) -> (message queue out=w32, error out=w31)
        w30 = default
      }
      on "Clear Faults" Value changed {
        call "Enqueue Message (Single).gviweb"(message queue in=w6, message="Clear Alerts") -> (message queue out=w32, error out=w31)
        w30 = default
      }
    }
    call "Error Handler - Event Handling Loop.gviweb"(message queue in=w32, error in=w31) -> (dup error in=w37)
    stop if w30
  }
  Unregister For Events(error in=w37, event registration refnum=s2) -> (error out=w38)
  Merge Errors(w38, w28) -> (error out=w39)
  Destroy User Event(error in=w39, user event=w3)
